# Dynamo graph script.dyn "Align Air Terminals to Ceiling Grids V2" (Dynamo 2.16.4.10216)
# packages: Genius Loci 2023.7.13, Sparrow 2021.2.1, bimorphNodes 5.1.3, Data-Shapes 2022.2.105, RIE 2021.7.3, Clockwork for Dynamo 2.x 2.12.2, Crumple 2024.4.3

# group: REAME
# note: GeniusLoci | v.2024.5.29
# Sparrow | v.2021.2.1
# BimorphNodes | v.5.1.3
# Data-Shapes | v.2025.3.118
# RIE | v.2021.7.3
# Clockwork |
# Crumple | v.2024.4.3

# group: Custom Node Selection by Category
# If Revit version < 2023
reset = BoolSelector(true)  # frozen
categories = Categories("OST_DuctTerminal")  # graph input; frozen
python_script = Python(IN[0]=reset, IN[1]=categories)  # IronPython2; frozen
# ---------- python_script.python (54 lines) ----------
# Load the Python Standard and DesignScript Libraries
import clr
clr.AddReference('RevitAPI')
import Autodesk
from Autodesk.Revit.DB import *

clr.AddReference('RevitAPIUI')
from Autodesk.Revit.UI import *
from Autodesk.Revit.UI.Selection import *
from Autodesk.Revit.UI.Selection import ObjectType

clr.AddReference("RevitNodes")
import Revit

clr.ImportExtensions(Revit.Elements)
clr.ImportExtensions(Revit.GeometryConversion)

clr.AddReference("RevitServices")
import RevitServices
from RevitServices.Persistence import DocumentManager

doc = DocumentManager.Instance.CurrentDBDocument
uidoc = DocumentManager.Instance.CurrentUIApplication.ActiveUIDocument
Ob_type = Autodesk.Revit.UI.Selection.ObjectType


# Code
class Selectionfilter(ISelectionFilter):
    def __init__(self, category):
        self.categories = category

    def AllowElement(self, element):
        if element.Category.Name in [c.Name for c in self.categories]:
            return True
        return False

    def AllowReference(self, reference, position):
        return False



# Assuming IN[0] and IN[1] are the category names from Dynamo
category = [UnwrapElement(IN[1])]

# Creating an instance of the selection filter with the given categories
selectionFilter = Selectionfilter(category)

# Using the filter to select elements by rectangle
refElements = uidoc.Selection.PickObjects(ObjectType.Element, selectionFilter,'Select elements in the specified categories')

elements = [doc.GetElement(ref.ElementId) for ref in refElements]

# Outputting the selected elements to Dynamo
OUT = elements
# ----------------------------------------
flatten = List.Flatten(list=python_script)

code_block = CodeBlock { "Use this to align elements to celings grid"; }
file_path = Filename("..\..\..\Personal\Revit API\Tools\GnuH Tools\Dynamo.extension\GnuH Tools.tab\Test.panel\Align air terminals to ceilings.pushbutton\icon.png")
file_from_path = FileObject(path=file_path)
code_block_2 = CodeBlock { "Run"; }
code_block_3 = CodeBlock { "Select Link Element. Can skip this if choose model"; }
code_block_4 = CodeBlock { "Select"; }
code_block_5 = CodeBlock { true; }
selectlinkedelement_s_data = Custom[SelectLinkedElement(s) Data](InputName=code_block_3, ButtonText=code_block_4, SelectSingleElement=code_block_5)  # package Data-Shapes; Create a button input for UI.MultipleInputForm++ that allows to select elements in à linked document. See www.data-shapes.net for more infos!
code_block_6 = CodeBlock { "Select Model"; }
code_block_7 = CodeBlock { "Select"; }
code_block_8 = CodeBlock { "Use this to align elements to celings grid"; }
file_path_2 = Filename("..\..\..\Personal\Revit API\Tools\GnuH Tools\Dynamo.extension\GnuH Tools.tab\Test.panel\Align air terminals to ceilings.pushbutton\icon.png")
file_from_path_2 = FileObject(path=file_path_2)
code_block_9 = CodeBlock { "Run"; }
code_block_10 = CodeBlock { "RVT Links?"; }
code_block_11 = CodeBlock { "Link/Model"; }
boolean_input = Custom[Boolean input](InputName=code_block_10, SideText=code_block_11)  # package Data-Shapes; Creates a boolean input for UI.MultipleInputForm ++ . Check out www.data-shapes.net for more infos!
code_block_12 = CodeBlock { "Select Category to Run"; }
code_block_13 = CodeBlock { ["Air Terminals","Sprinklers","Lighting Fixtures","Fire Alarm Devices"]; }
byName = Category.ByName(name=code_block_13)
code_block_14 = CodeBlock { 0; }
dropdown_data = Custom[DropDown Data](InputName=code_block_12, Keys=code_block_13, Values=byName, DefaultValueIndex=code_block_14)  # package Data-Shapes; Create data for DropDown input in UI.MultiInputForm ++ . Check out www.data-shapes.net for more infos.
list_create = List.Create(item0=boolean_input, item1=dropdown_data)
boolean = BoolSelector(true)
code_block_15 = CodeBlock { "https://www.youtube.com/@paper.engineer"; }
code_block_16 = CodeBlock { "Cancel"; }
code_block_17 = CodeBlock { 500; }
code_block_18 = CodeBlock { 170; }
multipleinputform = Custom[MultipleInputForm ++](Description_optional=code_block_8, Logo_optional=file_from_path_2, ButtonText_optional=code_block_9, Inputs=list_create, Toggle=boolean, LinkToHelp_optional=code_block_15, CancelButtonText_optional=code_block_16, Width_optional=code_block_17, LabelWidth_optional=code_block_18)  # package Data-Shapes; Create a form with multiple inputs. see www.data-shapes.net for tutorials and infos!
categories_2 = CodeBlock(a=multipleinputform.User_Inputs) { a[1]; }
code_block_19 = CodeBlock { false; }
selectmodelelements_data = Custom[SelectModelElements Data](InputName=code_block_6, ButtonText=code_block_7, CategoryFilter=categories_2, SelectSingleElement=code_block_19)  # package Data-Shapes; Creates a Revit element selection input for UI.MultipleInputForm++ . Check out www.data-shapes.net for more infos!
list_create_2 = List.Create(item0=selectlinkedelement_s_data, item1=selectmodelelements_data)
isNull = Object.IsNull(object=categories_2)
code_block_20 = CodeBlock { false; }
code_block_21 = CodeBlock { true; }
if_ = RefactoredIf(test=isNull, true=code_block_20, false=code_block_21)
code_block_22 = CodeBlock { "https://www.youtube.com/@paper.engineer"; }
code_block_23 = CodeBlock { "Cancel"; }
code_block_24 = CodeBlock { 550; }
code_block_25 = CodeBlock { 300; }
multipleinputform_2 = Custom[MultipleInputForm ++](Description_optional=code_block, Logo_optional=file_from_path, ButtonText_optional=code_block_2, Inputs=list_create_2, Toggle=if_, LinkToHelp_optional=code_block_22, CancelButtonText_optional=code_block_23, Width_optional=code_block_24, LabelWidth_optional=code_block_25)
elements = CodeBlock(a=multipleinputform_2.User_Inputs) { a[1]; }

# group: Select Element by Category
select_elements = DSModelElementsByCategorySelection("OST_DuctTerminal")  # 2 picked in the model; graph input
code_block_26 = CodeBlock(a=elements) { a; }

rvt_links = CodeBlock(a=multipleinputform.User_Inputs) { a[0]; }
element_links = CodeBlock(a=multipleinputform_2.User_Inputs) { a[0]; }

# group: Collector Ceiling Link
code_block_27 = CodeBlock { "Ceilings"; }
byName_2 = Category.ByName(name=code_block_27)
# note: Custom Node: BimorphNodesv.5.1.3
ofCategory = Revit.LinkElement.OfCategory(linkInstance=element_links, category=byName_2)
# note: If RVT links is False, do not use this node
select_references_link_if_rvt = DSModelElementByCategorySelection("OST_RvtLinks")  # "Select References Link (if RVT link is Falsem do not use this node)"; 1 picked in the model; graph input

# group: Collector Ceiling
code_block_28 = CodeBlock { true; }
# note: Custom Node: RIEv.2021.7.3
RIE_ActiveView = Custom[RIE_ActiveView](Refresh=code_block_28)  # package RIE; Returns active view in current document.
code_block_29 = CodeBlock { "Ceilings"; }
byName_3 = Category.ByName(name=code_block_29)
# note: Custom Node: Data-Shapesv.2025.3.118
all_elements_of_categories_in = Custom[All Elements Of Categories in View](Views=RIE_ActiveView, Categories=byName_3)  # package Data-Shapes; Retrieves all elements of the given categories in the given view

# group: HasRVTLinksOrNot?
if_2 = RefactoredIf(test=rvt_links, true=ofCategory, false=all_elements_of_categories_in)
haslinkinstanceornot = Python()  # CPython3; frozen; unwired: IN[0]
# ---------- haslinkinstanceornot.python (30 lines) ----------
# Load the Revit API Libraries
import clr
clr.AddReference('RevitServices')
clr.AddReference('RevitNodes')
clr.AddReference('RevitAPI')
clr.AddReference('ProtoGeometry')

from RevitServices.Persistence import DocumentManager
from Autodesk.Revit.DB import FilteredElementCollector, RevitLinkInstance, BuiltInCategory

# Lấy tài liệu hiện tại
currentDocument = DocumentManager.Instance.CurrentDBDocument

# Hàm kiểm tra Revit LinkInstance trong tài liệu
def HasRevitLinkInstance(document):
    try:
        # Lọc tất cả các đối tượng thuộc lớp RevitLinkInstance
        linkInstances = FilteredElementCollector(document).OfClass(RevitLinkInstance).ToElements()
        if linkInstances and len(linkInstances) > 0:
            return True
        else:
            return False
    except Exception as exception:
        return "Error: {}".format(str(exception))

# Gọi hàm và gán kết quả vào biến đầu ra
result = HasRevitLinkInstance(currentDocument)

# Gán kết quả cho Dynamo
OUT = result
# ----------------------------------------
rvt_link = BoolSelector(false)  # graph input

# group: Filter the wanted ceilings
# note: Custom Node: BimorphNodesv.5.1.3
intersectsElement = Revit.Element.IntersectsElement(elementSetA=code_block_26, elementSetB=if_2)
intersectingElements = Results.ElementIntersectionResult.IntersectingElements(elementIntersectionResult=intersectsElement)
flatten_2 = List.Flatten(list=intersectingElements)
uniqueItems = List.UniqueItems(list=flatten_2)

# group: IMPORTANT NODE: TO GET THE CEILINGS GRIDS CURVE
code_block_30 = CodeBlock { null; }
if_3 = RefactoredIf(test=rvt_links, true=element_links, false=code_block_30)
# note: Custom Node: Sparrowv.2021.2.1
getGridCurves = Sparrow.Revit.Ceilings.GetGridCurves(ceiling=uniqueItems, LinkInstance=if_3)
# note: Custom Node: GeniusLociv.2024.5.29
list_clean = Custom[List Clean](list=getGridCurves)  # package Genius Loci; Removes all Null, Empty and Blank from a list or nested list of lists.

# group: Get Intersection Point between Grids
# note: Custom Node: BimorphNodesv.5.1.3
intersectAll = Curve.IntersectAll(curves=list_clean)

# group: Create a Topo from Points
byPoints = Topography.ByPoints(points=intersectAll)
mesh = Topography.Mesh(topography=byPoints)

# note: Custom Node: GeniusLociv.2024.5.29
group_parallel_lines = Custom[Group Parallel Lines](lines=list_clean@L2)  # package Genius Loci; Groups parallel lines or linear elements together.
code_block_31 = CodeBlock { 0; }
vertical_lines = List.GetItemAtIndex(list=group_parallel_lines@L3, index=code_block_31)
code_block_32 = CodeBlock { 0; }
getItemAtIndex = List.GetItemAtIndex(list=vertical_lines@L2, index=code_block_32)
code_block_33 = CodeBlock { 1; }
getItemAtIndex_2 = List.GetItemAtIndex(list=vertical_lines@L2, index=code_block_33)
distanceTo = Geometry.DistanceTo(geometry=getItemAtIndex, other=getItemAtIndex_2)
round = Math.Round(number=distanceTo)
code_block_34 = CodeBlock { 1; }
getItemAtIndex_3 = List.GetItemAtIndex(list=group_parallel_lines@L3, index=code_block_34)
code_block_35 = CodeBlock { 0; }
getItemAtIndex_4 = List.GetItemAtIndex(list=getItemAtIndex_3@L2, index=code_block_35)
code_block_36 = CodeBlock { 1; }
getItemAtIndex_5 = List.GetItemAtIndex(list=getItemAtIndex_3@L2, index=code_block_36)
distanceTo_2 = Geometry.DistanceTo(geometry=getItemAtIndex_4, other=getItemAtIndex_5)
round_2 = Math.Round(number=distanceTo_2)
eq = round == round_2
filterByBoolMask = List.FilterByBoolMask(list=mesh, mask=eq)

# group: Get the center points
# DO NOT USE
square_ceilings = CodeBlock(a=filterByBoolMask.in) { a; }  # frozen
code_block_37 = CodeBlock { true; }

# group: Get the center points > MeshToolkit to get Triangulation/Mesh
# note: Custom Node: Clockwork
faceVertices = Custom[Mesh.FaceVertices](mesh=square_ceilings)  # package Clockwork for Dynamo 2.x; Gets the vertices of each face of a given mesh

# group: Get the center points > Vertices to PolyCurve
byPoints_2 = PolyCurve.ByPoints(points=faceVertices@L2, connectLastToFirst=code_block_37)
curves = PolyCurve.Curves(polyCurve=byPoints_2)
flatten_3 = List.Flatten(list=curves)

# group: Get the center points
endPoint = Curve.EndPoint(curve=flatten_3)
X = Point.X(point=endPoint)
startPoint = Curve.StartPoint(curve=flatten_3)
X_2 = Point.X(point=startPoint)
Y = Point.Y(point=endPoint)
Y_2 = Point.Y(point=startPoint)
Z = Point.Z(point=endPoint)
Z_2 = Point.Z(point=startPoint)
code_block_38 = CodeBlock(x2=X, x1=X_2, y2=Y, y1=Y_2, z2=Z, z1=Z_2) { i = x2 - x1; j = y2 - y1; k = z2 - z1; }
byCoordinates = Vector.ByCoordinates(x=code_block_38.i, y=code_block_38.j, z=code_block_38.k)

# group: Get the center points
XAxis = Vector.XAxis()
isParallel = Vector.IsParallel(vector=byCoordinates, otherVector=XAxis)
YAxis = Vector.YAxis()
isParallel_2 = Vector.IsParallel(vector=byCoordinates, otherVector=YAxis)
python_script_2 = Python(IN[0]=isParallel, IN[1]=isParallel_2)  # CPython3
# ---------- python_script_2.python (22 lines) ----------
import clr
clr.AddReference('ProtoGeometry')
from Autodesk.DesignScript.Geometry import *
#The inputs to this node will be stored as a list in the IN variables.
xv = IN[0]
yv = IN[1]
a = []
b = []
bool = []

for i,j in zip(xv,yv):
	try:
		if i==False and j==False:
			a.append(i)
			b.append(j)
			bool.append(True)	
		else:
			bool.append(False)
	except:
		print("error")
#Assign your output to the OUT variable.
OUT = bool
# ----------------------------------------
code_block_39 = CodeBlock { true; }
allIndicesOf = List.AllIndicesOf(list=python_script_2, item=code_block_39)
getItemAtIndex_6 = List.GetItemAtIndex(list=flatten_3, index=allIndicesOf)
code_block_40 = CodeBlock { 0.5; }
pointAtParameter = Curve.PointAtParameter(curve=getItemAtIndex_6, param=code_block_40)
uniqueItems_2 = List.UniqueItems(list=pointAtParameter)

# group: Get the height from Level to ceiling
# note: Custom Node: GeniusLociv.2024.5.29
closest_level = Custom[Closest Level](element=flatten_2)  # package Genius Loci; Return the closest level below the given element.
level_plane = Custom[Level Plane](level=closest_level)  # package Genius Loci; Constructs a Plane from a level.
compound_surfaces_references = Custom[Compound Surfaces References](element=flatten_2)  # package Genius Loci; Retrieves Top, Bottom and Side Faces, Materials, and references of a roof, floor, ceiling or wall if applicable. Also works with linked element.
code_block_41 = CodeBlock(a=compound_surfaces_references.Bottom_Surface) { a; }
distanceTo_3 = Geometry.DistanceTo(geometry=level_plane, other=code_block_41)
flatten_4 = List.Flatten(list=distanceTo_3)

# group: Get the center points of AT
geometry = Element.Geometry(element=code_block_26)
byUnion = Solid.ByUnion(solids=geometry)
centroid = Solid.Centroid(solid=byUnion)
flatten_5 = List.Flatten(list=centroid)

# group: Determine what air terminals belongs to ceilings
geometry_2 = Element.Geometry(element=uniqueItems)
flatten_6 = List.Flatten(list=geometry_2)
flatten_7 = List.Flatten(list=byUnion)
doesIntersect = Geometry.DoesIntersect(geometry=flatten_6, other=flatten_7, lacing=CrossProduct)
filterByBoolMask_2 = List.FilterByBoolMask(list=code_block_26, mask=doesIntersect@L2)
code_block_42 = CodeBlock(a=filterByBoolMask_2.in) { a; }

# group: Determine what air terminals needed to rotate and what angle to rotate
code_block_43 = CodeBlock { 89; }
facingOrientation = FamilyInstance.FacingOrientation(familyInstance=code_block_42)
XAxis_2 = Vector.XAxis()
angleWithVector = Vector.AngleWithVector(vector=facingOrientation, otherVector=XAxis_2)
gt = code_block_43 > angleWithVector
code_block_44 = CodeBlock(y=angleWithVector) { y-90; }
formula = Formula("if(x=false,y,z)", x=gt, y=code_block_44, z=angleWithVector)
round_3 = Math.Round(number=formula)
code_block_45 = CodeBlock { 89; }
code_block_46 = CodeBlock { 0; }
getItemAtIndex_7 = List.GetItemAtIndex(list=list_clean@L2, index=code_block_46)
direction = Line.Direction(line=getItemAtIndex_7)
angleWithVector_2 = Vector.AngleWithVector(vector=direction, otherVector=XAxis_2)
gt_2 = code_block_45 > angleWithVector_2
code_block_47 = CodeBlock(y=angleWithVector_2) { y-90; }
formula_2 = Formula("if(x=false,y,z)", x=gt_2, y=code_block_47, z=angleWithVector_2)
round_4 = Math.Round(number=formula_2)

# group: AT needed to rotate
eq_2 = round_3 == round_4
filterByBoolMask_3 = List.FilterByBoolMask(list=code_block_42@L2, mask=eq_2@L2)
code_block_48 = CodeBlock(a=filterByBoolMask_3.out) { a; }
flatten_8 = List.Flatten(list=code_block_48)

# group: Number of angle rotate
# note: Custom Node: Crumplev.2024.4.3
family_instancerotation = Custom[© Family.InstanceRotation](familyInstances=code_block_48@L2)  # package Crumple; Returns the rotation of both point and line based elements. Not as thorough as other nodes out there, but a bit faster and robust when you know your elements are likely family instances.
code_block_49 = CodeBlock(a=formula_2, b=family_instancerotation.angle) { a+(360-b); }
flatten_9 = List.Flatten(list=code_block_49)

# group: Get the center points
square_ceilings_2 = CodeBlock(a=filterByBoolMask.in) { a; }

# group: Get the center points > MeshToolkit to get Triangulation/Mesh
# note: Custom Node: Clockwork
faceVertices_2 = Custom[Mesh.FaceVertices](mesh=square_ceilings_2)

# group (continued): Get the center points
flatten_10 = List.Flatten(list=faceVertices_2@L2)
transpose = List.Transpose(lists=flatten_10)

# group: Get the center points > Create Triangle
code_block_50 = CodeBlock(a=transpose) { a[0]; }
code_block_51 = CodeBlock(a=transpose) { a[1]; }
code_block_52 = CodeBlock(a=transpose) { a[2]; }
# note: Custom Node: Clockwork
solveByPoints = Custom[Triangle.SolveByPoints](PointA=code_block_50, PointB=code_block_51, PointC=code_block_52)  # package Clockwork for Dynamo 2.x; Solves a triangle based on the XYZ coordinates of its vertices.
code_block_53 = CodeBlock(a=solveByPoints.Alpha) { a; }
round_5 = Math.Round(number=code_block_53)
code_block_54 = CodeBlock(a=solveByPoints.Beta) { a; }
round_6 = Math.Round(number=code_block_54)
code_block_55 = CodeBlock(a=solveByPoints.Gamma) { a; }
round_7 = Math.Round(number=code_block_55)
list_create_3 = List.Create(item0=round_5, item1=round_6, item2=round_7)
transpose_2 = List.Transpose(lists=list_create_3)

# group: Get the center points > Determine the point of the largest angle and other points
maximumItem = List.MaximumItem(list=transpose_2)
eq_3 = transpose_2@L2 == maximumItem@L1  # lacing=Longest
code_block_56 = CodeBlock { false; }
# note: Custom Node: RIEv.2021.7.3
RIE_IndexOf = Custom[RIE_IndexOf](list=eq_3@L2, Item=code_block_56)  # package RIE; Returns a sublistlist with all indexes for each item.
getItemAtIndex_8 = List.GetItemAtIndex(list=flatten_10@L2, index=RIE_IndexOf@L2)

# group: Get the center points > Create center point of the small line
transpose_3 = List.Transpose(lists=getItemAtIndex_8)
code_block_57 = CodeBlock(a=transpose_3) { a[0]; }
code_block_58 = CodeBlock(a=transpose_3) { a[1]; }
byStartPointEndPoint = Line.ByStartPointEndPoint(startPoint=code_block_57, endPoint=code_block_58)
code_block_59 = CodeBlock { 0.5; }
pointAtParameter_2 = Curve.PointAtParameter(curve=byStartPointEndPoint, param=code_block_59)

# group: Get the 1/3 points
rectangle_ceilings = CodeBlock(a=filterByBoolMask.out) { a; }

# group: Get the 1/3 points > MeshToolkit to get Triangulation/Mesh
# note: Custom Node: Clockwork
faceVertices_3 = Custom[Mesh.FaceVertices](mesh=rectangle_ceilings)

# group (continued): Get the 1/3 points
flatten_11 = List.Flatten(list=faceVertices_3@L2)
transpose_4 = List.Transpose(lists=flatten_11)

# group: Get the 1/3 points > Create Triangle
code_block_60 = CodeBlock(a=transpose_4) { a[0]; }
code_block_61 = CodeBlock(a=transpose_4) { a[1]; }
code_block_62 = CodeBlock(a=transpose_4) { a[2]; }
# note: Custom Node: Clockwork
solveByPoints_2 = Custom[Triangle.SolveByPoints](PointA=code_block_60, PointB=code_block_61, PointC=code_block_62)
code_block_63 = CodeBlock(a=solveByPoints_2.Alpha) { a; }
round_8 = Math.Round(number=code_block_63)
code_block_64 = CodeBlock(a=solveByPoints_2.Beta) { a; }
round_9 = Math.Round(number=code_block_64)
code_block_65 = CodeBlock(a=solveByPoints_2.Gamma) { a; }
round_10 = Math.Round(number=code_block_65)
list_create_4 = List.Create(item0=round_8, item1=round_9, item2=round_10)
transpose_5 = List.Transpose(lists=list_create_4)

# group: Get the 1/3 points > Determine the point of the largest angle and other points
code_block_66 = CodeBlock { 90; }
ne = transpose_5@L2 != code_block_66  # lacing=Longest
filterByBoolMask_4 = List.FilterByBoolMask(list=transpose_5, mask=ne)
code_block_67 = CodeBlock(a=filterByBoolMask_4.in) { a; }
maximumItem_2 = List.MaximumItem(list=code_block_67)
eq_4 = transpose_5@L2 == maximumItem_2@L1  # lacing=Longest
code_block_68 = CodeBlock { true; }
# note: Custom Node: RIEv.2021.7.3
RIE_IndexOf_2 = Custom[RIE_IndexOf](list=eq_4@L2, Item=code_block_68)
getItemAtIndex_9 = List.GetItemAtIndex(list=flatten_11@L2, index=RIE_IndexOf_2@L2)
flatten_12 = List.Flatten(list=getItemAtIndex_9)
code_block_69 = CodeBlock { false; }
RIE_IndexOf_3 = Custom[RIE_IndexOf](list=eq_4@L2, Item=code_block_69)
getItemAtIndex_10 = List.GetItemAtIndex(list=flatten_11@L2, index=RIE_IndexOf_3@L2)

# group: Get the 1/3 points > Create center point of the small line
transpose_6 = List.Transpose(lists=getItemAtIndex_10)
code_block_70 = CodeBlock(a=transpose_6) { a[0]; }
code_block_71 = CodeBlock(a=transpose_6) { a[1]; }
byStartPointEndPoint_2 = Line.ByStartPointEndPoint(startPoint=code_block_70, endPoint=code_block_71)
code_block_72 = CodeBlock { 0.5; }
pointAtParameter_3 = Curve.PointAtParameter(curve=byStartPointEndPoint_2, param=code_block_72)

# group: Get the 1/3 points > Get the center point of the line from largest angle to the center point of the small line
byStartPointEndPoint_3 = Line.ByStartPointEndPoint(startPoint=flatten_12, endPoint=pointAtParameter_3)
code_block_73 = CodeBlock { 0.5; }
pointAtParameter_4 = Curve.PointAtParameter(curve=byStartPointEndPoint_3, param=code_block_73)

# group: The POINTS we need
list_create_5 = List.Create(item0=pointAtParameter_2, item1=pointAtParameter_4)
flatten_13 = List.Flatten(list=list_create_5)

# group: Get the nearest distance
distanceTo_4 = Geometry.DistanceTo(geometry=flatten_5, other=flatten_13, lacing=CrossProduct)
minimumItem = List.MinimumItem(list=distanceTo_4@L2)

# group: Get assosiated center point of grids
indexOf = List.IndexOf(list=distanceTo_4@L2, element=minimumItem)
maximumItem_3 = List.MaximumItem(list=indexOf)
getItemAtIndex_11 = List.GetItemAtIndex(list=flatten_13, index=maximumItem_3)

# group: Move the air terminals to the center points of grids
# The Z point needs to reviewed
code_block_74 = CodeBlock { "Elevation from Level"; }
# note: Custom Node: RIEv.2021.7.3
RIE_Increment_Rotation = Custom[RIE_Increment_Rotation](elements=flatten_8, degrees=flatten_9)  # package RIE; Rotates input elements by input angle in degrees (CCW if positive). Angle can be single input or list input at equal size of elements' input list. Tags : Rotate Groups, Rotate Model Groups, Rotate Element, Rotate Family Instance.
code_block_75 = CodeBlock(passthrough=code_block_26, waitfor=RIE_Increment_Rotation) { [passthrough,waitfor][0]; }
setLocation = Element.SetLocation(element=code_block_75, geometry=getItemAtIndex_11)
code_block_76 = CodeBlock(passthrough=flatten_4, waitfor=setLocation) { [passthrough,waitfor][0]; }
setParameterByName = Element.SetParameterByName(element=code_block_26, parameterName=code_block_74, value=code_block_76)
code_block_77 = CodeBlock(passthrough=byPoints, waitfor=setParameterByName) { [passthrough,waitfor][0]; }
delete = Element.Delete(element=code_block_77)

filterByBoolMask_5 = List.FilterByBoolMask(list=round, mask=eq)
filterByBoolMask_6 = List.FilterByBoolMask(list=round_2, mask=eq)

# group: Determine what quater will rotate
# DO NOT USE
facingOrientation_2 = FamilyInstance.FacingOrientation(familyInstance=flatten_8)  # frozen
code_block_78 = CodeBlock(a=facingOrientation_2) { a.X; }
code_block_79 = CodeBlock { 2; }
round_11 = Math.Round(number=code_block_78, digits=code_block_79)
code_block_80 = CodeBlock { 0; }
code_block_81 = CodeBlock(a=round_11, b=code_block_80) { a>b; }
returnTrueOrFalse = Python(IN[0]=code_block_81, IN[1]=flatten_9)  # CPython3
# ---------- returnTrueOrFalse.python (30 lines) ----------
# Load the Python Standard and DesignScript Libraries
import clr
clr.AddReference('ProtoGeometry')
from Autodesk.DesignScript.Geometry import *

# Nhận input từ Dynamo
booleanInput = IN[0]  # Danh sách Boolean (True/False)
listCheck = IN[1]  # Danh sách các số

# Kiểm tra nếu listCheck là một danh sách, nếu không, đưa nó về dạng danh sách
listCheck = listCheck if isinstance(listCheck, list) else [listCheck]
booleanInput = booleanInput if isinstance(booleanInput, list) else [booleanInput]

# Đảm bảo hai danh sách có cùng độ dài
min_length = min(len(booleanInput), len(listCheck))
booleanInput = booleanInput[:min_length]
listCheck = listCheck[:min_length]

# Danh sách kết quả
result = []

# Xử lý dữ liệu
for i in range(min_length):
    if booleanInput[i]:  # Nếu là True
        result.append(-abs(listCheck[i]))  # Trả về số dương
    else:  # Nếu là False
        result.append(abs(listCheck[i]))  # Trả về số âm

# Gán kết quả vào OUT
OUT = result
# ----------------------------------------
filterByBoolMask_7 = List.FilterByBoolMask(mask=code_block_81)  # unwired: list

element_getrotation = Custom[Element GetRotation]()  # frozen; package Genius Loci; Calculates the rotation angle between the given element and the X axis. Works for point/ line/ sketch based elements and link instances.; unwired: element
boolean_2 = BoolSelector(true)
code_block_82 = CodeBlock { 800; }
