# Dynamo graph script.dyn "GET INFO STRAIGHT DUCT" (Dynamo 2.16.2.5624)
# This Script to export the information duct , duct fittings, duct accesorries before and aftet damper
# packages: MEPover 2024.9.25, Crumple 2024.4.3

run_code = CodeBlock { true; }

# group: GET ELEMENTS
UI = Python(IN[0]=run_code)  # IronPython2
# ---------- UI.python (75 lines) ----------
import os
import sys
import clr
import System
import math
from System.Collections.Generic import *

clr.AddReference("ProtoGeometry")
from Autodesk.DesignScript.Geometry import *

clr.AddReference('RevitAPI')
import Autodesk
from Autodesk.Revit.DB import *

clr.AddReference('RevitAPIUI')
from Autodesk.Revit.UI import *
from Autodesk.Revit.UI.Selection import *

clr.AddReference("RevitNodes")
import Revit

clr.ImportExtensions(Revit.Elements)
clr.ImportExtensions(Revit.GeometryConversion)

clr.AddReference("RevitServices")
import RevitServices
from RevitServices.Persistence import DocumentManager
from RevitServices.Transactions import TransactionManager

doc = DocumentManager.Instance.CurrentDBDocument
view = doc.ActiveView
uidoc = DocumentManager.Instance.CurrentUIApplication.ActiveUIDocument
uiapp = DocumentManager.Instance.CurrentUIApplication
app = uiapp.Application

"""-------------Preparing input from dynamo to revit----------------"""
INPUT = IN[0]

"""--------------------------Functions--------------------------"""
def ShowTaskDialog(title, mainInstruction, icon, mainContent,verificationText, footerText, footerUrl):
    # Tạo TaskDialog
    dialog = TaskDialog(title)
    dialog.TitleAutoPrefix = False
    dialog.MainInstruction = mainInstruction
    if icon:
        dialog.MainIcon = icon
    dialog.MainContent = mainContent
    dialog.CommonButtons = TaskDialogCommonButtons.Ok

    # Thêm checkbox vào TaskDialog
    dialog.VerificationText = verificationText
    
    # Định dạng FooterText với thẻ <a> và gán vào FooterText
    dialog.FooterText = '<a href="{0}">{1}</a>'.format(footerUrl, footerText)

    # Hiển thị TaskDialog và nhận kết quả
    dialog.Show()
    
    # Kiểm tra trạng thái của checkbox
    return dialog.WasVerificationChecked()

"""--------------------------Main Code--------------------------"""
if INPUT:
	result = ShowTaskDialog(
	                title="PKD",
	                mainInstruction="Select Mode",
	                icon=None,
	                mainContent="Choose In View will excecute all VAV,CAV elements in View\n\nChoose Picking will excecute Picking Objects",
	                verificationText = "IN VIEW / PICKING OBJECTS",
	                footerText="Get help",
	                footerUrl="https://www.youtube.com/@paper.engineer"
	            )

# Assign output to Dynamo
OUT = result
# ----------------------------------------
code_block = CodeBlock { "DP Typecode"; }
code_block_2 = CodeBlock { "Duct Accessories"; }
byName = Category.ByName(name=code_block_2)
all_elements_of_category = ElementsOfCategory(Category=byName)
code_block_3 = CodeBlock { true; }
code_block_4 = CodeBlock { false; }

ELEMENTS = Python(IN[0]=UI)  # IronPython2
# ---------- ELEMENTS.python (79 lines) ----------
import os
import sys
import clr
import System
import math
from System.Collections.Generic import *

clr.AddReference("ProtoGeometry")
from Autodesk.DesignScript.Geometry import *

clr.AddReference('RevitAPI')
import Autodesk
from Autodesk.Revit.DB import *

clr.AddReference('RevitAPIUI')
from Autodesk.Revit.UI import *
from Autodesk.Revit.UI.Selection import *

clr.AddReference("RevitNodes")
import Revit

clr.ImportExtensions(Revit.Elements)
clr.ImportExtensions(Revit.GeometryConversion)

clr.AddReference("RevitServices")
import RevitServices
from RevitServices.Persistence import DocumentManager
from RevitServices.Transactions import TransactionManager

doc = DocumentManager.Instance.CurrentDBDocument
view = doc.ActiveView
uidoc = DocumentManager.Instance.CurrentUIApplication.ActiveUIDocument
uiapp = DocumentManager.Instance.CurrentUIApplication
app = uiapp.Application

"""-------------Preparing input from dynamo to revit----------------"""
element = IN[0]

"""--------------------------Functions--------------------------"""
class SelectionFilter(ISelectionFilter):
    def __init__(self, category):
        self.category = category

    def AllowElement(self, element):
        if element.Category and element.Category.Name == self.category:
            return True
        return False

    def AllowReference(self, reference, position):
        return False

def CollectDuctAuto():
    """Automatically collect all duct accessories in the active view."""
    ductsEles = (
        FilteredElementCollector(doc, view.Id)
        .OfCategory(BuiltInCategory.OST_DuctAccessory)
        .WhereElementIsNotElementType()
        .ToElements()
    )
    return ductsEles


def CollectDuctManual():
    """Manually select duct accessories using Revit UI."""
    collectorDucts = uidoc.Selection.PickObjects(
        ObjectType.Element, SelectionFilter("Duct Accessories"), "Select Duct Accessories"
    )
    ductsEles = [doc.GetElement(s.ElementId) for s in collectorDucts]
    return ductsEles


"""--------------------------Main Code--------------------------"""
if element:
    result = CollectDuctAuto()
else:
    result = CollectDuctManual()

# Assign output to Dynamo
OUT = result
# ----------------------------------------

# group (continued): GET ELEMENTS
getparmetervaluebyname_get = Python(IN[0]=ELEMENTS, IN[1]=code_block)  # "GetParmeterValueByName (Get SharePara)"; CPython3
# ---------- getparmetervaluebyname_get.python (43 lines) ----------
# Load the Python Standard and DesignScript Libraries
import sys
import clr
clr.AddReference('ProtoGeometry')
from Autodesk.DesignScript.Geometry import *
clr.AddReference('RevitNodes')
clr.AddReference('RevitServices')
clr.AddReference('RevitAPI')
clr.AddReference('RevitAPIUI')

from RevitServices.Persistence import DocumentManager
from Autodesk.Revit.DB import *

# Get the current Revit document
doc = DocumentManager.Instance.CurrentDBDocument

# The inputs to this node will be stored as a list in the IN variables.
elements = UnwrapElement(IN[0])  # Unwrap Revit elements
parameterName = IN[1]            # Input parameter name
outputResults = []

# Ensure "elements" is iterable
if not isinstance(elements, list):
    elements = [elements]

# Loop through each element and get the family type
for element in elements:
    # Check if the element is a FamilyInstance
    if isinstance(element, FamilyInstance):
        familyType = element.Symbol
        if familyType:
            param = familyType.LookupParameter(parameterName)
            if param and param.HasValue:
                outputResults.append(param.AsString())
            else:
                outputResults.append(None)
        else:
            outputResults.append(None)
    else:
        outputResults.append("Not a FamilyInstance")

# Assign your output to the OUT variable
OUT = outputResults
# ----------------------------------------
filter_by_cav_and_vav = Python(IN[0]=getparmetervaluebyname_get)  # CPython3
# ---------- filter_by_cav_and_vav.python (20 lines) ----------
# Load the Python Standard and DesignScript Libraries
import sys
import clr
clr.AddReference('ProtoGeometry')
from Autodesk.DesignScript.Geometry import *

# The inputs to this node will be stored as a list in the IN variables.
elements = IN[0]
result = []

# Kiểm tra từng phần tử và trả về True nếu phần tử là "CAV" hoặc "VAV"
for e in elements:
    #if e == "CAV" or e == "VAV":
    if e and ("CAV" in e or "VAV" in e):
        result.append(True)
    else:
        result.append(False)

# Assign your output to the OUT variable.
OUT = result
# ----------------------------------------
filterByBoolMask = List.FilterByBoolMask(list=ELEMENTS, mask=filter_by_cav_and_vav)
isEmpty = List.IsEmpty(list=filter_by_cav_and_vav)  # frozen
if_ = RefactoredIf(test=isEmpty, true=code_block_3, false=code_block_4)
UI_2 = Python(IN[0]=if_)  # IronPython2
# ---------- UI_2.python (57 lines) ----------
import clr
clr.AddReference('System.Windows.Forms')
from System.Windows.Forms import FolderBrowserDialog, DialogResult

import os
import sys

import System
import math
from System.Collections.Generic import *

clr.AddReference("ProtoGeometry")
from Autodesk.DesignScript.Geometry import *

clr.AddReference('RevitAPI')
import Autodesk
from Autodesk.Revit.DB import *

clr.AddReference('RevitAPIUI')
from Autodesk.Revit.UI import *
from Autodesk.Revit.UI.Selection import *

clr.AddReference("RevitNodes")
import Revit

clr.ImportExtensions(Revit.Elements)
clr.ImportExtensions(Revit.GeometryConversion)

clr.AddReference("RevitServices")
import RevitServices
from RevitServices.Persistence import DocumentManager
from RevitServices.Transactions import TransactionManager

doc = DocumentManager.Instance.CurrentDBDocument
view = doc.ActiveView
uidoc = DocumentManager.Instance.CurrentUIApplication.ActiveUIDocument
uiapp = DocumentManager.Instance.CurrentUIApplication
app = uiapp.Application

def select_folder():
    folder_dialog = FolderBrowserDialog()
    folder_dialog.Description = "Select Folder"
    
    # Hiển thị hộp thoại và kiểm tra nếu người dùng chọn OK
    if folder_dialog.ShowDialog() == DialogResult.OK:
        return folder_dialog.SelectedPath
    else:
        return None

# Gọi hàm để chọn thư mục
if not IN[0]:
	selected_folder = select_folder()
else:
	TaskDialog.Show("Error","There is no any CAV or VAV")

	# Trả kết quả về Dynamo
	OUT = selected_folder if selected_folder else "No Folder"
# ----------------------------------------
directory_from_path = DirectoryObject(path=UI_2)

# group: RESET SCRIPT
code_block_5 = CodeBlock(a=filterByBoolMask.in) { a; }

# group: ID & Name
code_block_6 = CodeBlock(e=code_block_5) { e.Id; }
list_create = List.Create(item0=code_block_6)
flatten = List.Flatten(list=list_create)
code_block_7 = CodeBlock(e=code_block_5) { e.Name; }
list_create_2 = List.Create(item0=code_block_7)
flatten_2 = List.Flatten(list=list_create_2)

mep_connector_info = Custom[MEP Connector info+](element=code_block_5)  # package MEPover; This node will return the connectors and a lot of information about those connectors of the input elements

# group: System Name
code_block_8 = CodeBlock(a=mep_connector_info.SystemType) { a; }
code_block_9 = CodeBlock(e=code_block_8) { e.Name; }
code_block_10 = CodeBlock { "Ventilation Ud"; }
eq = code_block_9 == code_block_10
code_block_11 = CodeBlock { "Ventilation Ud"; }
code_block_12 = CodeBlock { "Ventilation Ind"; }
if_2 = RefactoredIf(test=eq, true=code_block_11, false=code_block_12)
code_block_13 = CodeBlock { 0; }
getItemAtIndex = List.GetItemAtIndex(list=if_2@L2, index=code_block_13)

# group: ENSURE TO ORDER IN/OUT
code_block_14 = CodeBlock(a=mep_connector_info.ConnectedElements) { a; }
string_from_object = FromObject(object=code_block_14)
code_block_15 = CodeBlock { "Duct"; }
eq_2 = string_from_object == code_block_15
filterByBoolMask_2 = List.FilterByBoolMask(list=code_block_14, mask=eq_2)
code_block_16 = CodeBlock(a=mep_connector_info.FlowDirection) { a; }
sortByKey = List.SortByKey(list=filterByBoolMask_2.in@L2, keys=code_block_16@L2)

# group: Length
code_block_17 = CodeBlock { "Length"; }
getParameterValueByName = Element.GetParameterValueByName(element=filterByBoolMask_2.in, parameterName=code_block_17)
sortByKey_2 = List.SortByKey(list=getParameterValueByName@L2, keys=code_block_16@L2)
flatten_3 = List.Flatten(list=sortByKey_2.sortedList@L2)
list_handel_between_2_or_1 = Python(IN[0]=flatten_3)  # CPython3
# ---------- list_handel_between_2_or_1.python (18 lines) ----------
# Input: List cấp 3 từ Dynamo
inputList = IN[0]

# Kết quả đầu ra
resultA0 = []
resultA1 = []

# Xử lý từng phần tử trong list cấp 3
for subList in inputList:
    if isinstance(subList, list):  # Kiểm tra nếu là list cấp 2
        resultA0.append(subList[0] if len(subList) > 0 else None)  # Lấy a[0]
        resultA1.append(subList[1] if len(subList) > 1 else None)  # Lấy a[1]
    else:
        resultA0.append(None)
        resultA1.append(None)

# Kết quả đầu ra: a[0] và a[1]
OUT = resultA0, resultA1
# ----------------------------------------
code_block_18 = CodeBlock(a=list_handel_between_2_or_1) { a[0]; }
code_block_19 = CodeBlock { 2; }
round = Math.Round(number=code_block_18, digits=code_block_19)
code_block_20 = CodeBlock(a=list_handel_between_2_or_1) { a[1]; }
round_2 = Math.Round(number=code_block_20, digits=code_block_19)

mep_connector_info_2 = Custom[MEP Connector info+](element=sortByKey.sortedList@L2)

# group: Filter to Get only Excatly Elements before and after damper
code_block_21 = CodeBlock(a=mep_connector_info_2.ConnectedElements) { a; }
string_from_object_2 = FromObject(object=code_block_21)
eq_3 = string_from_object_2@L3 == code_block_7  # lacing=Longest
filterByBoolMask_3 = List.FilterByBoolMask(list=code_block_21, mask=eq_3)
code_block_22 = CodeBlock(a=filterByBoolMask_3.out) { a; }
string_from_object_3 = FromObject(object=code_block_22)
code_block_23 = CodeBlock { "Duct"; }
eq_4 = string_from_object_3@L3 == code_block_23  # lacing=Longest
filterByBoolMask_4 = List.FilterByBoolMask(list=code_block_22, mask=eq_4)
code_block_24 = CodeBlock(a=filterByBoolMask_4.out) { a; }
string_from_object_4 = FromObject(object=code_block_24)
code_block_25 = CodeBlock { "DuctInsulation"; }
eq_5 = string_from_object_4@L3 == code_block_25  # lacing=Longest
filterByBoolMask_5 = List.FilterByBoolMask(list=code_block_24, mask=eq_5)
code_block_26 = CodeBlock(a=filterByBoolMask_5.out) { a; }
flatten_4 = List.Flatten(list=code_block_26@L3)

code_block_27 = CodeBlock(e=flatten_4) { e.Id; }
list_handel_between_2_or_1_2 = Python(IN[0]=code_block_27)  # CPython3; same code as list_handel_between_2_or_1
code_block_28 = CodeBlock(a=list_handel_between_2_or_1_2) { a[0]; }
code_block_29 = CodeBlock(e=flatten_4) { e.Name; }
list_handel_between_2_or_1_3 = Python(IN[0]=code_block_29)  # CPython3; same code as list_handel_between_2_or_1
code_block_30 = CodeBlock(a=list_handel_between_2_or_1_3) { a[0]; }
code_block_31 = CodeBlock(a=list_handel_between_2_or_1_2) { a[1]; }
code_block_32 = CodeBlock(a=list_handel_between_2_or_1_3) { a[1]; }

# group: Transpose Data
list_create_3 = List.Create(item0=flatten, item1=flatten_2, item2=getItemAtIndex, item3=round, item4=round_2, item5=code_block_28, item6=code_block_30, item7=code_block_31, item8=code_block_32)
transpose = List.Transpose(lists=list_create_3)

# group: Create Title
titile = CodeBlock { ["Element Id","Element Name","System Name","IN: LENGTH DUCT","OUT: LENGTH DUCT","IN END ID","IN END NAME","OUT END ID","OUT END NAME"]; }
addItemToFront = List.AddItemToFront(item=titile, list=transpose)

# group: OPTION 1: EXPORT EXCEL BY EXCEL FILE
excel_path = Filename("C:\Users\Cazorla\Desktop\TEST\INFO.xlsx")  # graph input
code_block_33 = CodeBlock { "INFO"; }
code_block_34 = CodeBlock { 0; }
code_block_35 = CodeBlock { true; }
exportToExcel = Data.ExportToExcel(filePath=excel_path, sheetName=code_block_33, startRow=code_block_34, startColumn=code_block_34, data=addItemToFront, overWrite=code_block_35)  # frozen

# group: RVT 2024 can use this
select_model_elements_by = DSModelElementsByCategorySelection("OST_DuctAccessory")  # "Select Model Elements By Category"; 3 picked in the model; graph input; frozen

# group: OPTION 2: EXPORT EXCEL BY FOLDER
folder_path = Directory("C:\Users\Cazorla\Desktop\TEST")  # graph input
code_block_36 = CodeBlock { "INFO TEST"; }
code_block_37 = CodeBlock { "INFO"; }
excel_exportasfile = Custom[🐍 Excel.ExportAsFile](diectoryPath=folder_path, fileName=code_block_36, sheetName=code_block_37, dataRows=addItemToFront)  # package Crumple; Exports a 2D matrix of data to a new file given a name and directory path. The node automatically adds a xlsx extension to the name. Credit to Cyril Poupin for most of the Python code (details in node body).
